% Requirement links of HilTest.m (R2026b)

% line 38 verifies requirements.slreqx#8
% line 38 verifies requirements.slreqx#9
% line 38 verifies requirements.slreqx#14
        function normalOperation(testCase)

% line 55 verifies requirements.slreqx#8
        function periodUnderCpuLoad(testCase)

% line 77 verifies requirements.slreqx#11
        function processingRate(testCase)

% line 95 verifies requirements.slreqx#14
% line 95 verifies requirements.slreqx#15
        function stallStopsSending(testCase)

% line 126 verifies requirements.slreqx#17
        function bootStatus(testCase)

% line 142 verifies requirements.slreqx#17
        function noModelStopsAfterBootTimeout(testCase)

% line 161 verifies requirements.slreqx#16
% line 161 verifies requirements.slreqx#14
        function canFailureKeepsRunning(testCase)