test file "unit_recognize"
  setup callback:
    load_system('unit_recognize'); set_param('unit_recognize', 'FixedStep', '1');
  cleanup callback:
    set_param('unit_recognize', 'FixedStep', 'auto');
  coverage: Decision, MCDC, Condition

suite "recognize"

  case "SWR01_class_of_each_sign" [baseline]
    model unit_recognize, stop time 3
    input "SWR01_class_of_each_sign.mat", mapped to rgb (active)
    baseline "SWR01_class_of_each_sign"
      cls
      ok

  case "SWR01_more_sign_frames" [baseline]
    model unit_recognize, stop time 7
    input "SWR01_more_sign_frames.mat", mapped to rgb (active)
    baseline "SWR01_more_sign_frames"
      cls
      ok

  case "SWR01_background_no_sign" [baseline]
    model unit_recognize, stop time 2
    input "SWR01_background_no_sign.mat", mapped to rgb (active)
    baseline "SWR01_background_no_sign"
      cls
      ok

  case "SWR01_sign_then_background" [baseline]
    model unit_recognize, stop time 3
    input "SWR01_sign_then_background.mat", mapped to rgb (active)
    baseline "SWR01_sign_then_background"
      cls
      ok